# Requirement set aeb_requirements (R2025b)

## 1 [REQ-01] Speed ≥ 30 km/h AND obstacle ≤ 20 m AND sensor valid → BRAKE
Expected output: BRAKE

## 2 [REQ-02] Speed < 30 km/h → NO_ACTION (regardless of obstacle)
Expected output: NO_ACTION

## 3 [REQ-03] Sensor age ≥ 200 ms → FAULT
Expected output: FAULT

## 4 [REQ-04] In FAULT, sensor healthy for 1 s → return to NORMAL
Expected output: NORMAL

## 5 [REQ-05] Speed outside [0, 250] km/h → FAULT (invalid input)
Expected output: FAULT