test file "aeb_tests"

suite "AEB-lite requirement tests"

  case "TC-01" [baseline]
    description: TC-01: designed test case, requirement REQ-01
    tags: REQ-01
    model aeb_model, stop time 0
    input "TC-01_input.mat", mapped to speed_kph, obstacle_detected, obstacle_m, sensor_age_ms, dt_ms (active)
    baseline "TC-01_expected.mat"
      unnamed

  case "TC-02" [baseline]
    description: TC-02: designed test case, requirement REQ-01
    tags: REQ-01
    model aeb_model, stop time 0
    input "TC-02_input.mat", mapped to speed_kph, obstacle_detected, obstacle_m, sensor_age_ms, dt_ms (active)
    baseline "TC-02_expected.mat"
      unnamed

  case "TC-03" [baseline]
    description: TC-03: designed test case, requirement REQ-01
    tags: REQ-01
    model aeb_model, stop time 0
    input "TC-03_input.mat", mapped to speed_kph, obstacle_detected, obstacle_m, sensor_age_ms, dt_ms (active)
    baseline "TC-03_expected.mat"
      unnamed

  case "TC-04" [baseline]
    description: TC-04: designed test case, requirement REQ-01
    tags: REQ-01
    model aeb_model, stop time 0
    input "TC-04_input.mat", mapped to speed_kph, obstacle_detected, obstacle_m, sensor_age_ms, dt_ms (active)
    baseline "TC-04_expected.mat"
      unnamed

  case "TC-05" [baseline]
    description: TC-05: designed test case, requirement REQ-01
    tags: REQ-01
    model aeb_model, stop time 0
    input "TC-05_input.mat", mapped to speed_kph, obstacle_detected, obstacle_m, sensor_age_ms, dt_ms (active)
    baseline "TC-05_expected.mat"
      unnamed

  case "TC-06" [baseline]
    description: TC-06: designed test case, requirement REQ-01
    tags: REQ-01
    model aeb_model, stop time 0
    input "TC-06_input.mat", mapped to speed_kph, obstacle_detected, obstacle_m, sensor_age_ms, dt_ms (active)
    baseline "TC-06_expected.mat"
      unnamed

  case "TC-11" [baseline]
    description: TC-11: designed test case, requirement REQ-02
    tags: REQ-02
    model aeb_model, stop time 0
    input "TC-11_input.mat", mapped to speed_kph, obstacle_detected, obstacle_m, sensor_age_ms, dt_ms (active)
    baseline "TC-11_expected.mat"
      unnamed

  case "TC-12" [baseline]
    description: TC-12: designed test case, requirement REQ-02
    tags: REQ-02
    model aeb_model, stop time 0
    input "TC-12_input.mat", mapped to speed_kph, obstacle_detected, obstacle_m, sensor_age_ms, dt_ms (active)
    baseline "TC-12_expected.mat"
      unnamed

  case "TC-21" [baseline]
    description: TC-21: designed test case, requirement REQ-03
    tags: REQ-03
    model aeb_model, stop time 0
    input "TC-21_input.mat", mapped to speed_kph, obstacle_detected, obstacle_m, sensor_age_ms, dt_ms (active)
    baseline "TC-21_expected.mat"
      unnamed

  case "TC-22" [baseline]
    description: TC-22: designed test case, requirement REQ-03
    tags: REQ-03
    model aeb_model, stop time 0
    input "TC-22_input.mat", mapped to speed_kph, obstacle_detected, obstacle_m, sensor_age_ms, dt_ms (active)
    baseline "TC-22_expected.mat"
      unnamed

  case "TC-41" [baseline]
    description: TC-41: designed test case, requirement REQ-05
    tags: REQ-05
    model aeb_model, stop time 0
    input "TC-41_input.mat", mapped to speed_kph, obstacle_detected, obstacle_m, sensor_age_ms, dt_ms (active)
    baseline "TC-41_expected.mat"
      unnamed

  case "TC-42" [baseline]
    description: TC-42: designed test case, requirement REQ-05
    tags: REQ-05
    model aeb_model, stop time 0
    input "TC-42_input.mat", mapped to speed_kph, obstacle_detected, obstacle_m, sensor_age_ms, dt_ms (active)
    baseline "TC-42_expected.mat"
      unnamed